# Dynamo graph BatchUpgrade-MonkeyJobNodes.dyn (Dynamo 2.0.3.8810)

# group: Input File Directory
directory_path = Directory("C:\Users\CAR11899\Documents\Glue\Glue Templates - 2019")

# group: Generate file paths for all rvt in directory
find_all_rvt_in_directory = Python(IN[0]=directory_path)
# ---------- find_all_rvt_in_directory.python (35 lines) ----------
# Enable Python support and load DesignScript library
import sys 
import clr
import System
from System import Array
from System.Collections.Generic import *
clr.AddReference('ProtoGeometry')
from Autodesk.DesignScript.Geometry import *

clr.AddReference("RevitNodes") # Import RevitNodes

clr.AddReference("RevitServices")
import RevitServices
from RevitServices.Persistence import DocumentManager
from RevitServices.Transactions import TransactionManager

clr.AddReference('RevitAPI') #import clr
from Autodesk.Revit.DB import * 

pyt_path = r'C:\Program Files (x86)\IronPython 2.7\Lib'
sys.path.append(pyt_path)

import os
from os import path
import glob

path = IN[0]
files = []

for root, dirnames, filenames in os.walk(path):
	temp = [file for file in glob.glob(root + "**/*.rvt")]
	if temp != []:
		files.append(temp)
		
OUT = files		
# ----------------------------------------
flatten = List.Flatten(list=find_all_rvt_in_directory)

# group: Set Open Options
audit_mode = BoolSelector(false)
detach_from_central = BoolSelector(true)
remove_revit_linked_projects = BoolSelector(false)

# group: File Opening Operation & Generate Log
docOperations = MonkeyJobNodes.DocOperations.DocOperations()
openSaveCloseDocumentFile = MonkeyJobNodes.DocOperations.OpenSaveCloseDocumentFile(docOperations=docOperations, filePath=flatten, audit=audit_mode, detachFromCentral=detach_from_central, deleteLinks=remove_revit_linked_projects)
generateLog = Python(IN[0]=flatten, IN[1]=openSaveCloseDocumentFile, IN[2]=directory_path)
# ---------- generateLog.python (24 lines) ----------
# Enable Python support and load DesignScript library
import clr
clr.AddReference('ProtoGeometry')
from Autodesk.DesignScript.Geometry import *

# The inputs to this node will be stored as a list in the IN variables.
dataEnteringNode = IN

filePath = IN[0]

result = IN[1]

originalDirectory = IN[2]

OUT = []

for i, x in enumerate(filePath):
	tempString = str(x) + "|" + result[i] + "\n"
	OUT.append(tempString)
# Place your code below this line

txtLog = open(str(originalDirectory)+"\BatchUpgradeLog.txt", "w+")
txtLog.writelines(OUT)
txtLog.close()
# ----------------------------------------
watch = Watch(generateLog)
