# Dynamo graph FilterByStructuralMaterial.dyn (Dynamo 2.2.1.5175)

# group: 1 - Input Material Keyword
material_keyword = CodeBlock { "Concrete"; }

# group: Find Materials with keyword as part of Structural Material
docOperations = MonkeyJobNodes.DocOperations.DocOperations()
docOperationsNeeds = MonkeyJobNodes.DocOperations.docOperationsNeeds(docOperations=docOperations)
checkStructuralMaterial = MonkeyJobNodes.Miscellaneous.checkStructuralMaterial(CurrentDocument=docOperationsNeeds.CurrentDocument, Material=material_keyword)

getAllElementsID = MonkeyJobNodes.Miscellaneous.getAllElementsID(currentDocument=docOperationsNeeds.CurrentDocument)
python_script = Python(IN[0]=checkStructuralMaterial, IN[1]=getAllElementsID)
# ---------- python_script.python (20 lines) ----------
# Load the Python Standard and DesignScript Libraries
import sys
import clr
clr.AddReference('ProtoGeometry')
from Autodesk.DesignScript.Geometry import *

# The inputs to this node will be stored as a list in the IN variables.
dataEnteringNode = IN

concElem = IN[0]

allElem = IN[1]

OUT = []

for elem in allElem:
	if elem in concElem:
		OUT.append(True)
	else:
		OUT.append(False)
# ----------------------------------------
filterByBoolMask = List.FilterByBoolMask(list=getAllElementsID, mask=python_script)
byElementId = archilab.Revit.Selection.Select.ByElementId(id=filterByBoolMask.out)
getElementType = MonkeyJobNodes.Miscellaneous.GetElementType(elem=byElementId, currentDoc=docOperationsNeeds.CurrentDocument)
watch = Watch(getElementType)
code_block = CodeBlock()
# ---------- code_block.designscript (2 lines) ----------
["Floor",
"Wall"];
# ----------------------------------------
python_script_2 = Python(IN[0]=getElementType, IN[1]=code_block)
# ---------- python_script_2.python (23 lines) ----------
# Load the Python Standard and DesignScript Libraries
import sys
import clr
clr.AddReference('ProtoGeometry')
from Autodesk.DesignScript.Geometry import *

# The inputs to this node will be stored as a list in the IN variables.
dataEnteringNode = IN

types = IN[0]

exceptionList = IN[1]

OUT = []

for type in types:
	temp = str(type).split(".")[-1]
	if temp in exceptionList:
		OUT.append(True)
	else:
		OUT.append(False)

# Place your code below this line
# ----------------------------------------
countFalse = List.CountFalse(list=python_script_2)
countTrue = List.CountTrue(list=python_script_2)
filterByBoolMask_2 = List.FilterByBoolMask(list=filterByBoolMask.out, mask=python_script_2)
list_create = List.Create(item0=filterByBoolMask.in, item1=filterByBoolMask_2.in)
code_block_2 = CodeBlock { 1; }
flatten = List.Flatten(list=list_create, amt=code_block_2)
byElementId_2 = archilab.Revit.Selection.Select.ByElementId(id=flatten)
isolate_in_view = Custom[Isolate in View](element=byElementId_2, view=docOperationsNeeds.CurrentView)  # This node will take input of elements and a view to isolate selected elements in a view.
