# Dynamo graph FilterConcreteElements.dyn (Dynamo 2.1.0.7500)

# group: Find Materials with keyword as part of Structural Material
docOperations = MonkeyJobNodes.DocOperations.DocOperations()
docOperationsNeeds = MonkeyJobNodes.DocOperations.docOperationsNeeds(docOperations=docOperations)

getAllElementsID = MonkeyJobNodes.Miscellaneous.getAllElementsID(currentDocument=docOperationsNeeds.CurrentDocument)
byElementId = archilab.Revit.Selection.Select.ByElementId(id=getAllElementsID)
type = archilab.Revit.Elements.Elements.Type(element=byElementId)
isNull = Object.IsNull(obj=type)
filterByBoolMask = List.FilterByBoolMask(list=byElementId, mask=isNull)
code_block = CodeBlock { false; }
getMaterials = Element.GetMaterials(element=filterByBoolMask.out, paintMaterials=code_block)
python_script = Python(IN[0]=getMaterials)
# ---------- python_script.python (16 lines) ----------
# Load the Python Standard and DesignScript Libraries
import sys
import clr
clr.AddReference('ProtoGeometry')
from Autodesk.DesignScript.Geometry import *

lists = IN[0]

OUT = []

for list in lists:
	if len(list) > 0:
		OUT.append(True)
	else:
		OUT.append(False)
	#OUT.append(list.GetType())
# ----------------------------------------
filterByBoolMask_2 = List.FilterByBoolMask(list=filterByBoolMask.out, mask=python_script)
boolean = BoolSelector(false)
getMaterials_2 = Element.GetMaterials(element=filterByBoolMask_2.in, paintMaterials=boolean)
name = Material.Name(material=getMaterials_2)
python_script_2 = Python(IN[0]=name)
# ---------- python_script_2.python (16 lines) ----------
# Load the Python Standard and DesignScript Libraries
import sys
import clr
clr.AddReference('ProtoGeometry')
from Autodesk.DesignScript.Geometry import *


lists = IN[0]
OUT = []

for list in lists:
	for x in list:
		if "concrete" in x or "Concrete" in x or "Metal - Deck" in x:
			OUT.append(True)
		else:
			OUT.append(False)
# ----------------------------------------
filterByBoolMask_3 = List.FilterByBoolMask(list=filterByBoolMask_2.in, mask=python_script_2)
name_2 = Element.Name(element=filterByBoolMask_3.out)
code_block_2 = CodeBlock()
# ---------- code_block_2.designscript (4 lines) ----------
["Conc over",
"Con Slab",
"Mtl Deck",
"Precast"];
# ----------------------------------------
python_script_3 = Python(IN[0]=name_2, IN[1]=code_block_2)
# ---------- python_script_3.python (18 lines) ----------
# Load the Python Standard and DesignScript Libraries
import sys
import clr
clr.AddReference('ProtoGeometry')
from Autodesk.DesignScript.Geometry import *

names = IN[0]

toFilter = IN[1]

OUT= []

for name in names:
	status = False
	for x in toFilter:
		if x in name:
			status = True
	OUT.append(status)
# ----------------------------------------
filterByBoolMask_4 = List.FilterByBoolMask(list=filterByBoolMask_3.out, mask=python_script_3)
select_model_element = DSModelElementSelection()  # 1 picked in the model
select_model_element_2 = DSModelElementSelection()  # 1 picked in the model
list_create = List.Create(item0=filterByBoolMask_3.in, item1=filterByBoolMask_4.in, item2=select_model_element, item3=select_model_element_2)
flatten = List.Flatten(list=list_create)
boolean_2 = BoolSelector(false)
dataSwitch = MonkeyJobNodes.Miscellaneous.DataSwitch(data=flatten, isDebug=boolean_2)
isolate_in_view = Custom[Isolate in View](element=dataSwitch.Release, view=docOperationsNeeds.CurrentView)  # This node will take input of elements and a view to isolate selected elements in a view.
watch = Watch(isolate_in_view)
color_palette = ColorPalette({R: 0, G: 0, B: 255, A: 255})
overrideColorInView = Element.OverrideColorInView(element=dataSwitch.Debug, color=color_palette)
watch_2 = Watch(name_2)
