# Dynamo graph HideElementsInView-MonkeyJobNodes.dyn (Dynamo 2.0.3.8810)

# group: 1 - Select all elements of the model
select_model_elements = DSModelElementsSelection()  # 3882 picked in the model

# group: 2 - Input desired project parameter
parameter_name = StringInput("4D Schedule Code")

# group: Find Project Parameter
getParameterValueByName = Element.GetParameterValueByName(element=select_model_elements, parameterName=parameter_name)

# group: Check if project parameter has value
isStringEmpty = MonkeyJobNodes.Miscellaneous.isStringEmpty(stringCont=getParameterValueByName)

# group: 3 - Select the view to hide elements on view
views = Views(index=8)

# group: Hide Elements In View
filterByBoolMask = List.FilterByBoolMask(list=select_model_elements, mask=isStringEmpty)
boolean = BoolSelector(true)
hideElements = Custom[View.HideElements](Element=filterByBoolMask.out, View=views, RunIt=boolean)  # This node will hide elements in specified view.
watch = Watch(hideElements)
