# Dynamo graph InputDataFromOldRevit(WithNoDuplicates)-MonkeyJobNodes.dyn (Dynamo 2.0.3.8810)

# group: Select Model Objects and Parameter Name
select_model_elements = DSModelElementsSelection()  # 466 picked in the model
code_block = CodeBlock { "4D Schedule Code"; }

# group: MonkeyJobNodes
doesProjectParameterExist = MonkeyJobNodes.Miscellaneous.DoesProjectParameterExist(elemDynamo=select_model_elements, paramName=code_block)

# group: Add Project Parameter on elements without project parameter
filterByBoolMask = List.FilterByBoolMask(list=select_model_elements, mask=doesProjectParameterExist.BooleanMask)
code_block_2 = CodeBlock { 0; }
getItemAtIndex = List.GetItemAtIndex(list=filterByBoolMask.in, index=code_block_2)
parameterByName = Parameter.ParameterByName(element=getItemAtIndex, name=code_block)
name = Parameter.Name(parameter=parameterByName)
group = Parameter.Group(parameter=parameterByName)
parameterType = Parameter.ParameterType(parameter=parameterByName)
group_2 = Parameter.Group(parameter=parameterByName)
boolean = BoolSelector(false)
getCategory = Element.GetCategory(element=filterByBoolMask.out)
uniqueItems = List.UniqueItems(list=getCategory)
createProjectParameter = Parameter.CreateProjectParameter(parameterName=name, groupName=group, type=parameterType, group=group_2, instance=boolean, categoryList=uniqueItems)
