# Dynamo graph InputDataFromOldRevit-MonkeyJobNodes.dyn "InputDataFromOldRevit" (Dynamo 2.0.2.6826)

# group: Get Categories
python_script = Python()  # unwired: IN[0]
# ---------- python_script.python (16 lines) ----------
import clr

# Import DocumentManager and TransactionManager
clr.AddReference("RevitServices")
import RevitServices
from RevitServices.Persistence import DocumentManager

# Import RevitAPI
clr.AddReference("RevitAPI")
import Autodesk
from Autodesk.Revit.DB import *

doc = DocumentManager.Instance.CurrentDBDocument


OUT = [i.Name for i in doc.Settings.Categories]
# ----------------------------------------
watch = Watch(python_script)
byName = Category.ByName(name=python_script)
boolean = BoolSelector(false)
clean = List.Clean(list=byName, preserveIndices=boolean)

# group: 1. Select Previous Revit Project Version
old_model = Filename("..\4D\Joao\APM-GWY-S-19.rvt")

# group: Open file
boolean_2 = BoolSelector(true)
ʳʰʸᵗʰᵐ_applications = Rhythm.Revit.Application.Applications.OpenDocumentFile(filePath=old_model, detachFromCentral=boolean_2)

# group: Get Previous Project Elements
ʳʰʸᵗʰᵐ_collector = Rhythm.Revit.Selection.Collector.ElementsOfCategoryInDocument(document=ʳʰʸᵗʰᵐ_applications, category=clean)
boolean_3 = BoolSelector(false)
clean_2 = List.Clean(list=ʳʰʸᵗʰᵐ_collector, preserveIndices=boolean_3)
flatten = List.Flatten(list=clean_2)
code_block = CodeBlock { "4D Schedule Code"; }

# group: Isolate elements with the desired Parameter
parameterByName = Parameter.ParameterByName(element=flatten, name=code_block)
string_from_object = FromObject(obj=parameterByName)
string = StringInput("4D")
boolean_4 = BoolSelector(true)
contains = String.Contains(str=string_from_object, searchFor=string, ignoreCase=boolean_4)
watch_2 = Watch(contains)
watch_3 = Watch(parameterByName)
filterByBoolMask = List.FilterByBoolMask(list=flatten, mask=contains)
filterByBoolMask_2 = List.FilterByBoolMask(list=parameterByName, mask=contains)
value = Parameter.Value(parameter=filterByBoolMask_2.in)
isNull = Object.IsNull(obj=value)
filterByBoolMask_3 = List.FilterByBoolMask(list=filterByBoolMask.in, mask=isNull)
watch_4 = Watch(filterByBoolMask_3.out)
filterByBoolMask_4 = List.FilterByBoolMask(list=filterByBoolMask_2.in, mask=isNull)
id = Element.Id(element=flatten)
filterByBoolMask_5 = List.FilterByBoolMask(list=id, mask=contains)
filterByBoolMask_6 = List.FilterByBoolMask(list=filterByBoolMask_5.in, mask=isNull)

# group: Add Values to parameter
value_2 = Parameter.Value(parameter=filterByBoolMask_4.out)
watch_5 = Watch(value_2)
byElementId = archilab.Revit.Selection.Select.ByElementId(id=filterByBoolMask_6.out)
name = Parameter.Name(parameter=filterByBoolMask_4.out)
ʳʰʸᵗʰᵐ_elements = Rhythm.Revit.Elements.Elements.SetParameterByNameTypeOrInstance(element=byElementId, parameterName=name, value=value_2)
isNull_2 = Object.IsNull(obj=ʳʰʸᵗʰᵐ_elements)

# group: Create New Project Parameter Into new Revit File
uniqueItems = List.UniqueItems(list=name)
group_name_as_string_e_g = StringInput("Identity Data")  # "Group Name as String (e.g., Identity Data)"
parameterType = Parameter.ParameterType(parameter=filterByBoolMask_4.out)
uniqueItems_2 = List.UniqueItems(list=parameterType)
number = DoubleInput(0)
getItemAtIndex = List.GetItemAtIndex(list=uniqueItems_2, index=number)
group = Parameter.Group(parameter=filterByBoolMask_4.out)
uniqueItems_3 = List.UniqueItems(list=group)
number_2 = DoubleInput(0)
getItemAtIndex_2 = List.GetItemAtIndex(list=uniqueItems_3, index=number_2)
boolean_5 = BoolSelector(true)
createProjectParameterForAllCategories = Parameter.CreateProjectParameterForAllCategories(parameterName=uniqueItems, groupName=group_name_as_string_e_g, type=getItemAtIndex, group=getItemAtIndex_2, instance=boolean_5)
