# Dynamo graph MatchDataBasedOnLocation.dyn (Dynamo 2.1.0.7500)

select_model_elements = DSModelElementsSelection()  # 4028 picked in the model
convertToAPIElement = MonkeyOnDynamo.DocOperations.ConvertToAPIElement(elementGeneral=select_model_elements)
removeNulls = Lists.Manage.RemoveNulls(Data=convertToAPIElement.BoundingBox)
removeNulls_2 = Lists.Manage.RemoveNulls(Data=convertToAPIElement.CenterBoundingBox)
python_script = Python(IN[0]=removeNulls_2.Cleaned)
# ---------- python_script.python (18 lines) ----------
# Enable Python support and load DesignScript library
import clr
clr.AddReference('ProtoGeometry')
from Autodesk.DesignScript.Geometry import *

# The inputs to this node will be stored as a list in the IN variables.
dataEnteringNode = IN

# Place your code below this line
points = IN[0]

OUT = []

for point in points:
	temp = str(point).replace("(", "").replace(")","")
	temp = temp.replace(", ", "_")
	OUT.append(temp)
# Assign your output to the OUT variable.
# ----------------------------------------
watch = Watch(python_script)
code_block = CodeBlock { "Null,Null"; }
removeNulls_3 = Lists.Manage.RemoveNulls(Data=convertToAPIElement.RevitApiElement)
removeItemAtIndex = List.RemoveItemAtIndex(list=convertToAPIElement.ElementID, indices=removeNulls_3.Indices)
removeNulls_4 = Lists.Manage.RemoveNulls(Data=convertToAPIElement.TempID)
python_script_2 = Python(IN[0]=removeItemAtIndex, IN[1]=removeNulls_4.Cleaned)
# ---------- python_script_2.python (18 lines) ----------
# Enable Python support and load DesignScript library
import clr
clr.AddReference('ProtoGeometry')
from Autodesk.DesignScript.Geometry import *

# The inputs to this node will be stored as a list in the IN variables.
dataEnteringNode = IN

# Place your code below this line

Ids = IN[0]

Center = IN[1]

OUT = []
for i, x in enumerate(Ids):
	temp = str(Ids[i]) + "," + str(Center[i])
	OUT.append(temp)
# ----------------------------------------
code_block_2 = CodeBlock { "ElementID,Location"; }
code_block_3 = CodeBlock { "Location"; }
generateDataTable = MonkeyOnDynamo.DocOperations.GenerateDataTable(Data=python_script_2, Headers=code_block_2, primaryKey=code_block_3)
generateDataTable_2 = MonkeyOnDynamo.DocOperations.GenerateDataTable(Data=python_script_2, Headers=code_block_2, primaryKey=code_block_3)
code_block_4 = CodeBlock { true; }
mergeDataTables = MonkeyOnDynamo.DocOperations.MergeDataTables(table1=generateDataTable, table2=generateDataTable_2, preserveChanges=code_block_4)
getDataTableInfo = MonkeyOnDynamo.DocOperations.GetDataTableInfo(dataTable=mergeDataTables)
watch_2 = Watch(getDataTableInfo)
dataTableContent = MonkeyOnDynamo.DocOperations.DataTableContent(dataTable=generateDataTable)
watch_3 = Watch(dataTableContent)
file_path = Filename("..\..\..\Scripts\TestFiles\Logs\Location_2020_Test.CSV")
watch_4 = Watch(python_script_2)
exportCSV = Data.ExportCSV(filePath=file_path, data=watch_4)
