# Dynamo graph OverrideColorInView-MonkeyJobNodes.dyn (Dynamo 2.0.3.8810)

# group: Select Model Elements and Project Parameter Name
select_model_elements = DSModelElementsSelection()  # 19033 picked in the model
project_parameter_name = StringInput("4D Schedule Code")

# group: Find Project Parameter and Check Value
getParameterValueByName = Element.GetParameterValueByName(element=select_model_elements, parameterName=project_parameter_name)
isStringEmpty = MonkeyJobNodes.Miscellaneous.isStringEmpty(stringCont=getParameterValueByName)

# group: Override Color in Current View
filterByBoolMask = List.FilterByBoolMask(list=select_model_elements, mask=isStringEmpty)
color_palette = ColorPalette({R: 0, G: 0, B: 255, A: 255})
overrideColorInView = Element.OverrideColorInView(element=filterByBoolMask.in, color=color_palette)
color_palette_2 = ColorPalette({R: 255, G: 0, B: 0, A: 255})
overrideColorInView_2 = Element.OverrideColorInView(element=filterByBoolMask.out, color=color_palette_2)
