# Dynamo graph SearchElemenents.dyn (Dynamo 2.2.1.5175)

docOperations = MonkeyJobNodes.DocOperations.DocOperations()
docOperationsNeeds = MonkeyJobNodes.DocOperations.docOperationsNeeds(docOperations=docOperations)
getAllElementsID = MonkeyJobNodes.Miscellaneous.getAllElementsID(currentDocument=docOperationsNeeds.CurrentDocument)
byElementId = archilab.Revit.Selection.Select.ByElementId(id=getAllElementsID)
isNull = Object.IsNull(obj=byElementId)
filterByBoolMask = List.FilterByBoolMask(list=byElementId, mask=isNull)
name = Element.Name(element=filterByBoolMask.out)

# group: Keyword
string = StringInput("access")

python_script = Python(IN[0]=name, IN[1]=string)
# ---------- python_script.python (21 lines) ----------
# Load the Python Standard and DesignScript Libraries
import sys
import clr
clr.AddReference('ProtoGeometry')
from Autodesk.DesignScript.Geometry import *

# The inputs to this node will be stored as a list in the IN variables.
eleNames = IN[0]

search = IN[1]

OUT = []

for name in eleNames:
	name = name.lower()
	temp = name.split(" ")
	#OUT.append(temp)
	if search in temp:
		OUT.append(True)
	else:
		OUT.append(False)
# ----------------------------------------
filterByBoolMask_2 = List.FilterByBoolMask(list=filterByBoolMask.out, mask=python_script)
name_2 = Element.Name(element=filterByBoolMask_2.in)
watch = Watch(name_2)
